# Dynamo graph Create Shared Parameter.dyn (Dynamo 2.3.0.5885)
# packages: archi-lab.net 2020.23.11

# group: PROJECT NAME, NUMBER AND GUIDELINES
# note: This script creates a shared parameter file based on data in an excel file.

# group: CREATE PARAMETERS
current_document = Custom[Current Document]()  # package archi-lab.net; Retrieves Current Document
code_block = CodeBlock { "PG_TEXT"; false; }
createSharedParameter = Parameter.CreateSharedParameter(group=code_block.out0, instance=code_block.out1)  # unwired: parameterName, groupName, type, categoryList

# group: IMPORT EXCEL DATA
file_path = Filename("Excel Spreadsheets\Create Shared Parameter.xlsx")
file_from_path = FileObject(path=file_path)
code_block_2 = CodeBlock { "Sheet2"; true; false; }
importExcel = Data.ImportExcel(file=file_from_path, sheetName=code_block_2.out0, readAsStrings=code_block_2.out1, showExcel=code_block_2.out2)

# group: REMOVE HEADERS
restOfItems = List.RestOfItems(list=importExcel)

# group: TRANSPOSE LIST
transpose = List.Transpose(lists=restOfItems)

# group: READ COLUMNS AND ROWS
code_block_3 = CodeBlock(lst=transpose)
# ---------- code_block_3.designscript (10 lines) ----------
param = lst[0];
guid = lst[1];
name = lst[2];
datatype = lst[3];
datacategory = lst[4];
group = lst[5];
visible = lst[6];
description = lst[7];
usermodifiable = lst[8];
hidewhennovalue = lst[9];
# ----------------------------------------
combine = List.Combine(comb=createSharedParameter, list1=code_block_3.param, list2=code_block_3.guid, list3=code_block_3.name, list4=code_block_3.datatype, list5=code_block_3.datacategory, list6=code_block_3.group, list7=code_block_3.visible, list8=code_block_3.description, list9=code_block_3.usermodifiable, list10=code_block_3.hidewhennovalue)
watch = Watch(combine)
watch_2 = Watch()  # unwired: arg0

watch_3 = Watch(importExcel)
watch_4 = Watch(restOfItems)
