# Dynamo graph Create a Beam or Wall.dyn (Dynamo 2.3.0.5885)
# packages: SNAN 0.0.1

code_block = CodeBlock { 1000; -3000; }

# group: Create A WAll
# note: Distance between the two points.
byCoordinates = Point.ByCoordinates(x=code_block.out1)  # frozen
code_block_2 = CodeBlock { 2000; }
byCoordinates_2 = Point.ByCoordinates(x=code_block_2)  # frozen
byStartPointEndPoint = Line.ByStartPointEndPoint(startPoint=byCoordinates, endPoint=byCoordinates_2)
levels = Levels("Level 0")
wall_types = WallTypes("Wall-Fnd_440Blk")
code_block_3 = CodeBlock { 2000; }
python_script = Python(IN[0]=byStartPointEndPoint, IN[1]=levels, IN[2]=wall_types, IN[3]=code_block_3)
# ---------- python_script.python (42 lines) ----------
# Load the Python Standard and DesignScript Libraries
import sys
import clr
clr.AddReference('ProtoGeometry')
from Autodesk.DesignScript.Geometry import *
clr.AddReference('ProtoGeometry')
from Autodesk.DesignScript.Geometry import *

clr.AddReference('RevitServices')
import RevitServices
from RevitServices.Persistence import DocumentManager 
from RevitServices.Transactions import TransactionManager
doc = DocumentManager.Instance.CurrentDBDocument

clr.AddReference('RevitAPI')
import Autodesk
from Autodesk.Revit.DB import *

clr.AddReference('RevitNodes')
import Revit
clr.ImportExtensions(Revit.Elements)
clr.ImportExtensions(Revit.GeometryConversion)



# The inputs to this node will be stored as a list in the IN variables.
lines = IN[0]
level = UnwrapElement(IN[1])
type = UnwrapElement(IN[2])
height = UnitUtils.ConvertToInternalUnits(IN[3],DisplayUnitType.DUT_MILLIMETERS)
output = []



# Place your code below this line
TransactionManager.Instance.EnsureInTransaction(doc)
wall = Wall.Create(doc,lines.ToRevitType(),type.Id,level.Id, height, 0, 0, 1)
output = append(wall)
TransactionManager.Instance.TransactionTaskDone()

# Assign your output to the OUT variable.
OUT = output
# ----------------------------------------

# group: Create A Beam
code_block_4 = CodeBlock { 3000; 8000; }
byCoordinates_3 = Point.ByCoordinates(x=code_block_4.out1, z=code_block_4.out0)
code_block_5 = CodeBlock { 7000; 8000; }
byCoordinates_4 = Point.ByCoordinates(x=code_block_5.out1, y=code_block_5.out0, z=code_block_4.out0)
byStartPointEndPoint_2 = Line.ByStartPointEndPoint(startPoint=byCoordinates_3, endPoint=byCoordinates_4)
levels_2 = Levels("Level 1")
structural_framing_types = StructuralFramingTypes(index=0)
beamByCurve = StructuralFraming.BeamByCurve(curve=byStartPointEndPoint_2, level=levels_2, structuralFramingType=structural_framing_types)  # frozen

# group: TIME SAVED
number = DoubleInput(1)

# group: TESTING OR RUNNING
boolean = BoolSelector(false)

# group: BIM INSIGHT
log = Custom[log](Time_saved=number, Testing=boolean)  # package SNAN

# group: Create A Beam
code_block_6 = CodeBlock { 2000; 8000; }
byCoordinates_5 = Point.ByCoordinates(x=code_block_6.out1, z=code_block_6.out0)
code_block_7 = CodeBlock { 7000; 8000; }
byCoordinates_6 = Point.ByCoordinates(x=code_block_7.out1, y=code_block_7.out0, z=code_block_6.out0)
byStartPointEndPoint_3 = Line.ByStartPointEndPoint(startPoint=byCoordinates_5, endPoint=byCoordinates_6)
levels_3 = Levels("Level 1")
structural_framing_types_2 = StructuralFramingTypes("UB305x165x40")
beamByCurve_2 = StructuralFraming.BeamByCurve(curve=byStartPointEndPoint_3, level=levels_3, structuralFramingType=structural_framing_types_2)  # frozen

# group: CREATE MULTIPLE BEAMS
list_create = List.Create(item0=byStartPointEndPoint_3, item1=byStartPointEndPoint_2)
levels_4 = Levels("Level 1")
structural_framing_types_3 = StructuralFramingTypes("UB305x165x40")
beamByCurve_3 = StructuralFraming.BeamByCurve(curve=list_create, level=levels_4, structuralFramingType=structural_framing_types_3)
