# Dynamo graph Data From Revit To Excel And Back.dyn (Dynamo 2.3.0.5885)
# packages: bimorphNodes 3.0.3, Rhythm 2020.2.13

# group: PICK CATEGORY
categories = Categories("OST_Schedules")  # frozen
all_elements_of_category = ElementsOfCategory(Category=categories)

# group: PICKS PARAMETERS
id = Element.Id(element=all_elements_of_category)
code_block = CodeBlock { "Keynote"; }  # frozen
getParameterValueByName = Element.GetParameterValueByName(element=all_elements_of_category, parameterName=code_block)
code_block_2 = CodeBlock { "Type Mark"; }  # frozen
getParameterValueByName_2 = Element.GetParameterValueByName(element=all_elements_of_category, parameterName=code_block_2)

# group: COMBINES DATA
list_create = List.Create(item0=id, item1=getParameterValueByName, item2=getParameterValueByName_2)

# group: FLIPS DATA
transpose = List.Transpose(lists=list_create)

# group: PUSH DATA INTO EXCEL
file_path = Filename(".\Data from revit To Excel And Back.xlsx")  # frozen
code_block_3 = CodeBlock { "Sheet1"; }  # frozen
number = DoubleInput(0)  # frozen
boolean = BoolSelector(true)  # frozen
exportExcel = Data.ExportExcel(filePath=file_path, sheetName=code_block_3, startRow=number, startCol=number, data=transpose, overWrite=boolean)
watch = Watch(exportExcel)

# group: PULL DATA FROM EXCEL
file_path_2 = Filename("No file selected.")  # frozen
file_from_path = FileObject(path=file_path_2)
string = StringInput("\"Sheet2\"")  # frozen
boolean_2 = BoolSelector(true)
importExcel = Data.ImportExcel(file=file_from_path, sheetName=string, readAsStrings=boolean_2)

# group: FLIPS DATA
transpose_2 = List.Transpose()  # frozen; unwired: lists

# group: ELEMENTS ID
integer_slider = IntegerSlider(1, range=0..100 step 1)  # frozen
getItemAtIndex = List.GetItemAtIndex(list=transpose_2, index=integer_slider)

# group: KEYNOTE
integer_slider_2 = IntegerSlider(1, range=0..100 step 1)  # frozen
getItemAtIndex_2 = List.GetItemAtIndex(list=transpose_2, index=integer_slider_2)

# group: PARAMETER NAME
code_block_4 = CodeBlock { "Type MArk"; }  # frozen

# group: PICK CATEGORY
categories_2 = Categories("OST_Schedules")  # frozen
all_elements_of_category_2 = ElementsOfCategory(Category=categories_2)

# group: PARAMETER NAME
code_block_5 = CodeBlock { "Keynote"; }  # frozen

# group: TYPE MARK
integer_slider_3 = IntegerSlider(1, range=0..100 step 1)  # frozen
getItemAtIndex_3 = List.GetItemAtIndex(list=transpose_2, index=integer_slider_3)

# group: PUSH EXCEL DATA INTO PARAMETER
setParameterByName = Element.SetParameterByName(element=all_elements_of_category_2, parameterName=code_block_5, value=getItemAtIndex_3)
watch_2 = Watch(setParameterByName)

schedule_views = ScheduleViews("PAT_Coordination-Multi-Category Schedule")
boolean_3 = BoolSelector(false)
boolean_4 = BoolSelector(true)
getData = Revit.Schedule.GetData(scheduleView=schedule_views, removeHeading=boolean_3, refresh=boolean_4)
watch_3 = Watch(getData)
getParameterValueByName_3 = Element.GetParameterValueByName(element=getData)  # unwired: parameterName
getParameterValueByName_4 = Element.GetParameterValueByName(element=getData)  # unwired: parameterName
code_block_6 = CodeBlock { "Family"; }
