# Dynamo graph Duplicate Views.dyn (Dynamo 1.3.2.2480)

code_block = CodeBlock { "Whole Stadium Lower Levels"; }
categories = Categories("VolumeOfInterest")
all_elements_of_category = ElementsOfCategory(categories)
watch = Watch(all_elements_of_category)
code_block_2 = CodeBlock { "Whole Stadium"; }
filterByName = Custom[Elements.FilterByName](elements=watch, searchString=code_block_2)  # frozen; Retrieves those elements from a collection whose names match the search string
watch_2 = Watch(filterByName.first)
geometry = Custom[Springs.ScopeBox.Geometry](scopeBox=watch_2)  # Fetches the base curve and solid representation of a scope box element.
watch_3 = Watch(geometry.polyCurve)
byCoordinates = Point.ByCoordinates()
offset = Custom[Springs.Curve.Offset+](point=byCoordinates)  # Offsets a curve towards the specified point; unwired: curve, distance
boolean = BoolSelector(false)
currentSelection = Custom[Springs.Collector.CurrentSelection](refresh=boolean)  # Gets the currently selected elements. Connect a boolean switch to refresh the selection.
name = Element.Name(currentSelection)
code_block_3 = CodeBlock { -5; }
code_block_4 = CodeBlock { 0; }
remove = String.Remove(str=name, startIndex=code_block_3, count=code_block_4)
code_block_5 = CodeBlock { 0; }
code_block_6 = CodeBlock { "CONSOURSE AV SCREEN - "; }
insert = String.Insert(str=remove, index=code_block_5, toInsert=code_block_6)
duplicate = Custom[View.Duplicate](view=currentSelection, name=insert)  # frozen; Duplicates a given view
code_block_7 = CodeBlock { 0; }
getItemAtIndex = List.GetItemAtIndex(list=duplicate, index=code_block_7)
cropView = Custom[View.CropView](Views=duplicate)  # frozen; Crop a 3D view
getCropBoxCurves = Custom[View.GetCropBoxCurves](Views=cropView)  # returns the curves of a view crop box, even irregular shapes. Returns an empty list if the crop view is not active for a given view
code_block_8 = CodeBlock { 0; }
getItemAtIndex_2 = List.GetItemAtIndex(list=getCropBoxCurves, index=code_block_8)
watch_4 = Watch(getItemAtIndex_2)
byJoinedCurves = PolyCurve.ByJoinedCurves(watch_4)
code_block_9 = CodeBlock { -2000; }
offset_2 = Curve.Offset(curve=byJoinedCurves, distance=code_block_9)
watch_5 = Watch(offset_2)
flatten = Flatten(watch_5)
byJoinedCurves_2 = PolyCurve.ByJoinedCurves(flatten)
setCropBoxCurves = Custom[View.SetCropBoxCurves](Views=getItemAtIndex, Curves=byJoinedCurves_2)  # Input views and lists of curves to set the view crop regions
watch_6 = Watch(setCropBoxCurves)
view_templates = ViewTemplatesUi("TV Screens")
setViewTemplate = archilab.Revit.Views.Views.SetViewTemplate(duplicate, view_templates)
sortByKey = List.SortByKey(list=setViewTemplate, keys=insert)
watch_7 = Watch(sortByKey.sorted_keys)
string_from_object = FromObject(watch_7)
code_block_10 = CodeBlock()
# ---------- code_block_10.designscript (3 lines) ----------
{"STA-B-ID-03-AZ-1007",
"STA-B-ID-04-AZ-1007",
"STA-BID-A6-AZ-1007"};
# ----------------------------------------
family_types = FamilyTypes("AD-Titleblock-A1_Landscape:AD-Titleblock-A1_Landscape")
byNameNumberTitleBlockAndView = Sheet.ByNameNumberTitleBlockAndView(sheetName=string_from_object, sheetNumber=code_block_10, titleBlockFamilyType=family_types, view=currentSelection)
watch_8 = Watch(byNameNumberTitleBlockAndView)
watch_9 = Watch(sortByKey.sorted_list)
duplicateWithDetailing = Custom[View.DuplicateWithDetailing](view=currentSelection, name=insert)  # frozen; Duplicates a given view with detailing
code_block_11 = CodeBlock { "Door Colours"; }
duplicate_2 = archilab.Revit.Views.ViewTemplates.Duplicate(arg1=code_block_11)  # frozen; unwired: arg0
getCropBoxCurves_2 = Custom[View.GetCropBoxCurves](Views=duplicate)  # frozen
sortByKey_2 = List.SortByKey()  # unwired: list, keys
