# Dynamo graph Edit Titleblocks Parameter FromExcel.dyn "Edit_Titleblocks_Parameter_FromExcel" (Dynamo 2.3.0.5885)

# group: Import From Excel
file_path = Filename(".\Edit_Titleblock_Parameter_FromExcel.xlsx")
file_from_path = FileObject(path=file_path)
code_block = CodeBlock { "Sheet2"; }
code_block_2 = CodeBlock { false; }
importExcel = Data.ImportExcel(file=file_from_path, sheetName=code_block, showExcel=code_block_2)
code_block_3 = CodeBlock { 0; 1; }
getItemAtIndex = List.GetItemAtIndex(list=importExcel, index=code_block_3.out1)
getItemAtIndex_2 = List.GetItemAtIndex(list=importExcel, index=code_block_3.out0)
watch = Watch(getItemAtIndex)

# group: Sort
code_block_4 = CodeBlock { 0; }
getItemAtIndex_3 = List.GetItemAtIndex(list=getItemAtIndex, index=code_block_4)

# group: New Parameter
string = StringInput("AA")  # graph input
string_2 = StringInput("24.04.2020")  # graph input

# group: Sort
code_block_5 = CodeBlock { 1; }
getItemAtIndex_4 = List.GetItemAtIndex(list=getItemAtIndex, index=code_block_5)

# group: Sort
code_block_6 = CodeBlock { 2; }
getItemAtIndex_5 = List.GetItemAtIndex(list=getItemAtIndex, index=code_block_6)

# group: Sort
code_block_7 = CodeBlock { 6; }
getItemAtIndex_6 = List.GetItemAtIndex(list=getItemAtIndex, index=code_block_7)

# group: Sort
code_block_8 = CodeBlock { 5; }
getItemAtIndex_7 = List.GetItemAtIndex(list=getItemAtIndex, index=code_block_8)

# group: Sort
code_block_9 = CodeBlock { 4; }
getItemAtIndex_8 = List.GetItemAtIndex(list=getItemAtIndex, index=code_block_9)

# group: Sort
code_block_10 = CodeBlock { 3; }
getItemAtIndex_9 = List.GetItemAtIndex(list=getItemAtIndex, index=code_block_10)

# group: Sort
code_block_11 = CodeBlock { 7; }
getItemAtIndex_10 = List.GetItemAtIndex(list=getItemAtIndex, index=code_block_11)

# group: Sort
code_block_12 = CodeBlock { 8; }
getItemAtIndex_11 = List.GetItemAtIndex(list=getItemAtIndex, index=code_block_12)

# group: Sort
code_block_13 = CodeBlock { 9; }
getItemAtIndex_12 = List.GetItemAtIndex(list=getItemAtIndex, index=code_block_13)

# group: Populate Fields
categories = Categories("OST_Sheets")  # graph input
all_elements_of_category = ElementsOfCategory(Category=categories)
string_3 = StringInput("Checked By")  # graph input
setParameterByName = Element.SetParameterByName(element=all_elements_of_category, parameterName=string_3, value=getItemAtIndex_3)
categories_2 = Categories("OST_Sheets")  # graph input
all_elements_of_category_2 = ElementsOfCategory(Category=categories_2)
string_4 = StringInput("Drawn By")  # graph input
setParameterByName_2 = Element.SetParameterByName(element=all_elements_of_category_2, parameterName=string_4, value=getItemAtIndex_4)
categories_3 = Categories("OST_Sheets")  # graph input
all_elements_of_category_3 = ElementsOfCategory(Category=categories_3)
string_5 = StringInput("Designed By")  # graph input
setParameterByName_3 = Element.SetParameterByName(element=all_elements_of_category_3, parameterName=string_5, value=getItemAtIndex_5)
categories_4 = Categories("OST_Sheets")  # graph input
all_elements_of_category_4 = ElementsOfCategory(Category=categories_4)
string_6 = StringInput("Project Status")  # graph input
setParameterByName_4 = Element.SetParameterByName(element=all_elements_of_category_4, parameterName=string_6, value=getItemAtIndex_6)
categories_5 = Categories("OST_Sheets")  # graph input; frozen
all_elements_of_category_5 = ElementsOfCategory(Category=categories_5)  # frozen
string_7 = StringInput("Sheet Number")  # graph input; frozen
setParameterByName_5 = Element.SetParameterByName(element=all_elements_of_category_5, parameterName=string_7, value=getItemAtIndex_7)  # frozen
categories_6 = Categories("OST_Sheets")  # graph input; frozen
all_elements_of_category_6 = ElementsOfCategory(Category=categories_6)
string_8 = StringInput("Sheet Number")  # graph input; frozen
setParameterByName_6 = Element.SetParameterByName(element=all_elements_of_category_6, parameterName=string_8, value=getItemAtIndex_8)  # frozen
categories_7 = Categories("OST_Sheets")  # graph input
all_elements_of_category_7 = ElementsOfCategory(Category=categories_7)
string_9 = StringInput("Sheet Number")  # graph input
setParameterByName_7 = Element.SetParameterByName(element=all_elements_of_category_7, parameterName=string_9, value=getItemAtIndex_10)
categories_8 = Categories("OST_Sheets")  # graph input
all_elements_of_category_8 = ElementsOfCategory(Category=categories_8)
string_10 = StringInput("Status")  # graph input
setParameterByName_8 = Element.SetParameterByName(element=all_elements_of_category_8, parameterName=string_10, value=getItemAtIndex_11)
categories_9 = Categories("OST_Sheets")  # graph input
all_elements_of_category_9 = ElementsOfCategory(Category=categories_9)
string_11 = StringInput("Revision")  # graph input
setParameterByName_9 = Element.SetParameterByName(element=all_elements_of_category_9, parameterName=string_11, value=getItemAtIndex_12)
categories_10 = Categories("OST_Sheets")  # graph input
all_elements_of_category_10 = ElementsOfCategory(Category=categories_10)
string_12 = StringInput("")  # graph input
setParameterByName_10 = Element.SetParameterByName(element=all_elements_of_category_10, parameterName=string_12)  # unwired: value

# group: Sort
code_block_14 = CodeBlock { 10; }
getItemAtIndex_13 = List.GetItemAtIndex(index=code_block_14)  # unwired: list

# group: Sort
code_block_15 = CodeBlock { 10; }
getItemAtIndex_14 = List.GetItemAtIndex(list=getItemAtIndex, index=code_block_15)

# group: Sort
code_block_16 = CodeBlock { 11; }
getItemAtIndex_15 = List.GetItemAtIndex(list=getItemAtIndex, index=code_block_16)

# group: Sort
code_block_17 = CodeBlock { 12; }
getItemAtIndex_16 = List.GetItemAtIndex(list=getItemAtIndex, index=code_block_17)

# group: Sort
code_block_18 = CodeBlock { 13; }
getItemAtIndex_17 = List.GetItemAtIndex(list=getItemAtIndex, index=code_block_18)

# group: Drawing Title
categories_11 = Categories("OST_Sheets")  # graph input
all_elements_of_category_11 = ElementsOfCategory(Category=categories_11)
string_13 = StringInput("Description")  # graph input
setParameterByName_11 = Element.SetParameterByName(element=all_elements_of_category_11, parameterName=string_13, value=getItemAtIndex_9)
categories_12 = Categories("OST_Sheets")  # graph input
all_elements_of_category_12 = ElementsOfCategory(Category=categories_12)
string_14 = StringInput("Stage/Phase")  # graph input
setParameterByName_12 = Element.SetParameterByName(element=all_elements_of_category_12, parameterName=string_14, value=getItemAtIndex_14)
categories_13 = Categories("OST_Sheets")  # graph input
all_elements_of_category_13 = ElementsOfCategory(Category=categories_13)
string_15 = StringInput("Sheet Name")  # graph input
setParameterByName_13 = Element.SetParameterByName(element=all_elements_of_category_13, parameterName=string_15, value=getItemAtIndex_15)
categories_14 = Categories("OST_Sheets")  # graph input
all_elements_of_category_14 = ElementsOfCategory(Category=categories_14)
string_16 = StringInput("SheetType")  # graph input
setParameterByName_14 = Element.SetParameterByName(element=all_elements_of_category_14, parameterName=string_16, value=getItemAtIndex_16)
categories_15 = Categories("OST_Sheets")  # graph input
all_elements_of_category_15 = ElementsOfCategory(Category=categories_15)
string_17 = StringInput("Project/Subproject")  # graph input
setParameterByName_15 = Element.SetParameterByName(element=all_elements_of_category_15, parameterName=string_17, value=getItemAtIndex_17)
