# Dynamo graph Excel to Revit.dyn (Dynamo 2.3.0.5885)

file_path = Filename("C:\Users\Natasha.Newbold\Documents\BIM\Dynamo Script\Create Floor levels From Excel.xlsx")
file_from_path = FileObject(path=file_path)
code_block = CodeBlock { "Sheet1"; }
code_block_2 = CodeBlock { false; }
importExcel = Data.ImportExcel(file=file_from_path, sheetName=code_block, showExcel=code_block_2)
code_block_3 = CodeBlock { 0; 1; }
getItemAtIndex = List.GetItemAtIndex(list=importExcel, index=code_block_3.out0)
code_block_4 = CodeBlock(id=getItemAtIndex) { Revit.ElementSelector.ByElementId(id); }
code_block_5 = CodeBlock { "Name"; }
getItemAtIndex_2 = List.GetItemAtIndex(list=importExcel, index=code_block_3.out1)
setParameterByName = Element.SetParameterByName(element=code_block_4, parameterName=code_block_5, value=getItemAtIndex_2)
