# Dynamo graph Gather Data from project.dyn (Dynamo 2.3.0.5885)
# packages: Rhythm 2020.2.13, SNAN 0.0.1

# group: PROJECT NAME, NUMBER AND GUIDELINES
# note: Project: Everton football Stadium
# Project Number: 074
# Packages:
# This script collects data form the project. It will list the parameter name and the data associated to that parameter.

# group: GET DATA FROM MODEL
categories = Categories("OST_Walls")
all_elements_of_category = ElementsOfCategory(Category=categories)
string = StringInput("Length")
ʳʰʸᵗʰᵐ_elements = Rhythm.Revit.Elements.Elements.GetParameterValueByNameCaSeiNSeNSiTiVe(element=all_elements_of_category, parameterName=string)
watch = Watch(ʳʰʸᵗʰᵐ_elements)
string_2 = StringInput("Area")
ʳʰʸᵗʰᵐ_elements_2 = Rhythm.Revit.Elements.Elements.GetParameterValueByNameCaSeiNSeNSiTiVe(element=all_elements_of_category, parameterName=string_2)
watch_2 = Watch(ʳʰʸᵗʰᵐ_elements_2)

# group: GET NAMES AND DATA
number = DoubleInput(8)
ofRepeatedItem = List.OfRepeatedItem(item=string, amount=number)
number_2 = DoubleInput(8)
ofRepeatedItem_2 = List.OfRepeatedItem(item=string_2, amount=number_2)
list_create = List.Create(item0=all_elements_of_category, item1=ofRepeatedItem, item2=watch, item3=ofRepeatedItem_2, item4=watch_2)
watch_3 = Watch(list_create)
list_create_2 = List.Create(item0=all_elements_of_category, item1=watch_2)
watch_4 = Watch(list_create_2)
transpose = List.Transpose(lists=list_create)

# group: LIST PARAMETER AND DATA
watch_5 = Watch(transpose)

# group: TIME SAVED
number_3 = DoubleInput(1)

# group: TESTING OR RUNNING
boolean = BoolSelector(true)

# group: BIM INSIGHT
log = Custom[log](Time_saved=number_3, Testing=boolean)  # package SNAN
