# Dynamo graph Get All Elements On A Workset.dyn (Dynamo 2.3.0.5885)
# packages: archi-lab.net 2020.23.11, EvolveLAB-Beaker 2.0.1, SNAN 0.0.1

# group: GET ALL ELEMENTS ON SELECTED WORKSET
worksets = WorksetUi("AR-BRICK_PANELS ")
byWorkset = archilab.Revit.Selection.Select.ByWorkset(workset=worksets)
watch = Watch(byWorkset)

relay = Relay(byWorkset)

# group: LOOK FOR A SPECIFIC ELEMENT ON SELECTED WORKSET
string = StringInput("PAT_Hazard_Marker")
byName = Revit.ElementFilter.ByName(element=relay, name=string)  # frozen
watch_2 = Watch(byName)

# group: LOOK FOR A SPECIFIC ELEMENT ON SELECTED WORKSET
string_2 = StringInput("Family5")
byName_2 = Revit.ElementFilter.ByName(element=relay, name=string_2)  # frozen
watch_3 = Watch(byName_2)

# group: LOG
number = DoubleInput(0.3)
boolean = BoolSelector(false)
log = Custom[log](Time_saved=number, Testing=boolean)  # package SNAN
