# Dynamo graph Get, Change and Create A Workset.dyn "Get_Change_Create A Workset" (Dynamo 2.3.0.5885)
# packages: archi-lab.net 2020.23.11

# group: LIST WORKSETS
worksets = WorksetUi("\"PAT-AR-TEST_WORKSET")  # frozen
watch = Watch(worksets)

# group: CREATE A NEW WORKSET
string = StringInput("PAT-AR-TEST_WORKSET")  # frozen
byName = archilab.Revit.Elements.Workset.ByName(name=string)
watch_2 = Watch(byName)

# group: RENAME A WORKSET
worksets_2 = WorksetUi("Workset1")  # frozen
string_2 = StringInput("PAT-AR-TEST_WORKSET1")  # frozen
rename = archilab.Revit.Elements.Workset.Rename(workset=worksets_2, name=string_2)
watch_3 = Watch(rename)

# group: SELECT ALL ELEMENTS ON A WORKSET
worksets_3 = WorksetUi("Workset1")
byWorkset = archilab.Revit.Selection.Select.ByWorkset(workset=worksets_3)
watch_4 = Watch(byWorkset)

# group: LIST ALL WORKSETS
getAll = archilab.Revit.Elements.Workset.GetAll()
watch_5 = Watch(getAll)
